vi "Main.gviweb"   [LabVIEW NXG 2.0.0]
panel controls:
  "Slider": f64
  "Numeric": f64 = 300000
  "Slider_3": f64
  "Slider_4": f64
panel indicators:
  "Tank": f64
  "Graph": f64[][]
  "Gauge": f64
  "Radial Progress Bar": f64
  "Data Grid": T1[]
  "URL Image": string
  "URL Image_2": string
  "LED": bool
types:
  T1 = cluster{"Testers": string, "Test Progress": f64, "Test Status": bool}
diagram:
  while {
    Add($Slider, $Numeric) -> w1
    $Tank <- w1
    Is Greater(x=w1, y=500000) -> w2
    $LED <- w2
    Wait(time to wait=150)
    stop if FALSE
  }
  while {
    Random Number() -> (number (0 to 1)=w3)
    Divide(x=w3, y=10) -> w4
    Add($Slider_3, w4) -> w5
    $Gauge <- w5
    Wait(time to wait=150)
    stop if FALSE
  }
  w6 = [{"Testers"="e-DUT-13A", "Test Progress"=96, "Test Status"=TRUE}, {"Testers"="f-DUT-46C", "Test Progress"=33, "Test Status"=FALSE}, {"Testers"="g-DUT-55k", "Test Progress"=75, "Test Status"=TRUE}, {"Testers"="g-DUT-87H", "Test Progress"=5, "Test Status"=TRUE}, {"Testers"="g-DUT-MAB", "Test Progress"=100, "Test Status"=FALSE}]
  $"Data Grid" <- w6
  $"Radial Progress Bar" <- $Slider_4
  while {
    for (N = 100) (iteration -> i1) {
      Divide(x=i1, y=10) -> w9
      Sine(x=w9) -> w10
      Random Number() -> (number (0 to 1)=w11)
      Add(w10, w11) -> w12
      Random Number() -> (number (0 to 1)=w13)
      Divide(x=w13, y=10) -> w14
      Add(w14, 1) -> w15
      append w12 to w7
      append w15 to w8
    }
    Build Array(w7, w8) -> w16
    $Graph <- w16
    Wait(time to wait=16)
    stop if FALSE
  }
